# Grasshopper definition myTruss.gh (Grasshopper 1.0.7)
# plug-ins: FEM-Design

X = UnitX(Factor=1)
pt = Point(Point(0, 0, 0))
Z = UnitZ(Factor="3")
line = LineSDL(Start=pt, Direction=X, Length="12")
move = Move(Geometry=line, Motion=Z)  # -> Geometry, Transform
default = MaterialDatabaseDefault(CountryCode="S")
merge = Merge(Data1=line, Data2=move.Geometry)
default_2 = SectionDatabaseDefault()
divide = DivideCurve(Curve=merge, Count="5", Kinks=False)  # -> Points, Tangents, Parameters
listsectionnames = SectionDatabaseListSectionNames(SectionDatabase=default_2)
listmaterialnames = MaterialDatabaseListMaterialNames(MaterialDatabase=default)
flip = FlipMatrix(Data=divide.Points)
pline = PolyLine(Vertices=divide.Points, Closed=False)
pline_2 = PolyLine(Vertices=flip, Closed=False)
getmaterialbyname = MaterialGetMaterialByName(MaterialDatabase=default, MaterialName="S235J0")
item = ListItem(List=listsectionnames, Index="563", Wrap=True)
getsectionbyname = SectionGetSectionByName(SectionDatabase=default_2, SectionName=item)
explode = Explode(Curve=pline, Recursive=True)  # -> Segments, Vertices
end = EndPoints(Curve=line)  # -> Start, End
create = LoadCaseCreate(Name="VERTICAL LOAD", Type="Ordinary", DurationClass="permanent")
Z_2 = UnitZ(Factor="-10")
pointsupport = PointSupport(Plane=[end.Start, end.End], Tx=True, Ty=True, Tz=True, Rx=True, Ry=True, Rz=True, Identifier="S")
beam = BarsBeam(Curve=pline_2, Material=getmaterialbyname, Section=getsectionbyname, OrientLCS=True, Identifier="B")
beam_2 = BarsBeam(Curve=explode.Segments, Material=getmaterialbyname, Section=getsectionbyname, OrientLCS=True, Identifier="B")
force = PointLoadForce(Point=divide.Points, Force=Z_2, LoadCase=create)
create_2 = LoadCombinationCreate(Name="myCombo", Type="ultimate_ordinary", LoadCase=create, Gamma="1.50")
create_3 = LoadGroupCreate(
    Name="myGroup",
    Type=0,
    LoadCase=create,
    StandardUnfavourableSafetyFactor="1.35",
    StandardFavourableSafetyFactor=1,
    AccidentalUnfavourableSafetyFactor=1,
    AccidentalFavourableSafetyFactor=1,
    LoadCaseRelationship=0,
    Xi="1.0",
    PotentiallyLeadingAction=1)
create_4 = ModelCreate(
    CountryCode="S",
    StructureElements=flatten([beam, beam_2, pointsupport]),
    Loads=flatten(force),
    LoadCases=create,
    LoadCombinations=create_2,
    LoadGroups=create_3)
define = CombDefine(
    NLEmaxiter=30,
    PLdefloadstep=20,
    PLminloadstep=2,
    Plmaxeqiter=30,
    NLSMohr=True,
    NLSinitloadstep=10,
    NLSminloadstep=10,
    NLSactiveelemratio=5,
    NLSplasticelemratio=5,
    CRloadstep=20,
    CRmaxiter=30,
    CRstifferror=2)
define_2 = DesignDefine(AutoDesign=Toggle(True), Check=True)
toggle = BooleanToggle(True)
toggle_2 = BooleanToggle(True)
define_3 = DesignDefine(AutoDesign=Toggle(True), Check=True, BasedOn=Toggle(False), ApplyChanges=False)
define_4 = AnalysisDefine(
    Comb=define,
    CalcCase=toggle,
    CalcCstage=False,
    CalcImpf=False,
    CalcComb=toggle,
    CalcGmax=False,
    CalcStab=False,
    CalcFreq=False,
    CalcSeis=False,
    CalcDesign=False,
    CalcFootfall=False,
    Elemfine=False,
    Diaphragm=False,
    PeakSmoothing=False)
units = Units(Length="m", Angle="rad", SectionalData="m", Force="kN", Mass="kg", Displacement="m", Stress="Pa")
python = GhPythonScript()  # -> a
# ---------- python: Python ----------
__author__ = "MarcoPellegrinoKonsu"
__version__ = "2022.07.25"

import rhinoscriptsyntax as rs
import os
a = os.path.join(rs.DocumentPath(), "myTruss.struxml")
# ---------- end python ----------
open = ModelOpen(FdModel=create_4, FilePathStruxml=python, CloseOpenWindows=False, RunNode=Toggle(False))
rundesign = ApplicationRunDesign(
    Mode="steel",
    FdModel=create_4,
    FilePathStruxml=python,
    Analysis=define_4,
    Design=define_3,
    Units=units,
    EndSession=Toggle(False),
    CloseOpenWindows=False,
    RunNode=Toggle(True))  # -> FdModel, FdFeaModel, Results, HasExited
