# Grasshopper definition Example 7 - Wall with supports, loads, loadcases.gh (Grasshopper 1.0.7)
# plug-ins: FemDesign.Grasshopper

# ---- group: Geometry
width_m = Slider(4.56, range=3..6)
height_m = Slider(4.37, range=3..6)
xz_plane = XZPlane(Origin=Point(0, 0, 0))
rectangle = Rectangle(Plane=xz_plane, XSize=width_m, YSize=height_m, Radius=0)  # -> Rectangle, Length
boundary_surfaces = BoundarySurfaces(Edges=rectangle.Rectangle)
deconstruct_brep = DeconstructBrep(Brep=boundary_surfaces)  # -> Faces, Edges, Vertices
curve_middle = CurveMiddle(Curve=deconstruct_brep.Edges)
deconstruct = Deconstruct(Point=curve_middle)  # -> XComponent, YComponent, ZComponent
sort_list = SortList(Keys=deconstruct.ZComponent, ValuesValuesA=deconstruct_brep.Edges)  # -> Keys, ValuesValuesA
edges = Curve(sort_list.ValuesValuesA)

# ----
# 1. Creating the Geometry
# The first part of the script is focus on the Geometry generation. You can vary
# the width and the height of the Wall.
# 
# Surface and Edges have been extracted and used as input later.
surface = Surface(boundary_surfaces)

# ----
# Example 7: Modelling a Wall
# This example show how you can create a simple parametric model of a Wall.
# The main idea is being able to customize the Load and Boundary Condition
# with simple inputs, and having the resulting model built automatically.
info = Info()

# ---- group: load case
loadcase_create = LoadCaseCreate(Name="Wind Load", Type="static", DurationClass="permanent")
loadcase_create_2 = LoadCaseCreate(Name="Vertical Load", Type="dead_load", DurationClass="permanent")
loadcase_create_3 = LoadCaseCreate(Name="Horizontal Load", Type="static", DurationClass="permanent")

# ---- group: element
# 3. Constructing the Wall FEA element
# Before sending the elements off to the final model, you can add a component to define the size
# of the mesh in FEM-design.
surface_2 = Surface(surface)
materialdatabase_default = MaterialDatabaseDefault(CountryCode="S")
materialdatabase_listmaterialnames = MaterialDatabaseListMaterialNames(MaterialDatabase=materialdatabase_default)
find_similar_member = FindSimilarMember(Data="C 30-37", Set=materialdatabase_listmaterialnames)  # -> Hit, Index
material_getmaterialbyname = MaterialGetMaterialByName(MaterialDatabase=materialdatabase_default, MaterialName=find_similar_member.Hit)
thickness_m = Panel("0.30")
slab_wall = SlabWall(Surface=surface_2, Thickness=thickness_m, Material=material_getmaterialbyname, Identifier="P")

# ----
# 4. Creating loads
# The loads in this example are simple surface loads, but applying more
# complicated loads and load combinations is also possible.
# All loads are applied to the top flange.
merge = Merge(Data1=loadcase_create_2, Data2=loadcase_create_3, Data3=loadcase_create)

# ----
# 2. Creating Supports
# This example showcases a possible approach to create some rigid supports along a line.
# The supports are properly connected to the mesh when the FEM-Design model is generated.
curve = Curve(edges)

# ---- group: line support
list_item = ListItem(List=curve, Index="0", Wrap=True)
curve_2 = Curve(list_item)
end_points = EndPoints(Curve=curve_2)  # -> Start, End
line = Line(StartPoint=end_points.Start, EndPoint=end_points.End)
linesupport_hinged = LineSupportHinged(Curve=line, MovingLocal=False, OrientLCS=True, Identifier="S")

# ---- group: point support
list_item_2 = ListItem(List=curve, Index="3", Wrap=True)
curve_3 = Curve(list_item_2)
end_points_2 = EndPoints(Curve=curve_3)  # -> Start, End
pointsupport_hinged = PointSupportHinged(Point=[end_points_2.Start, end_points_2.End], Identifier="S")

# ---- group: line load
curve_4 = Curve(edges)
list_item_3 = ListItem(List=curve_4, Index="3", Wrap=True)
curve_5 = Curve(list_item_3)
end_points_3 = EndPoints(Curve=curve_5)  # -> Start, End
panel = Panel("-10.00")
unit_z = UnitZ(Factor=panel)
line_2 = Line(StartPoint=end_points_3.Start, EndPoint=end_points_3.End)
lineload_force = LineLoadForce(Curve=line_2, StartForce=unit_z, LoadCase=loadcase_create_2, ConstLoadDir=True)

# ---- group: point load
point = Point(deconstruct_brep.Vertices)
list_item_4 = ListItem(List=point, Index="2", Wrap=True)
kn = Panel("-5.00")
unit_x = UnitX(Factor=kn)
pointload_force = PointLoadForce(Point=list_item_4, Force=unit_x, LoadCase=loadcase_create_3)

# ---- group: surface load
surface_3 = Surface(surface)
panel_2 = Panel("2.00")  # "kN/m2"
unit_y = UnitY(Factor=panel_2)
surfaceload_uniform = SurfaceLoadUniform(Surface=surface_3, Force=unit_y, LoadCase=loadcase_create)

# ---- group: load combination
panel_3 = Panel("""1.35
1.50
1.50""")
panel_4 = Panel("""1.00
1.00
1.00""")
loadcombination_create = LoadCombinationCreate(Name="SLS", Type="serviceability_characteristic", LoadCase=merge, Gamma=panel_4)
loadcombination_create_2 = LoadCombinationCreate(Name="ULS", Type="ultimate_ordinary", LoadCase=merge, Gamma=panel_3)
merge_2 = Merge(Data1=loadcombination_create, Data2=loadcombination_create_2)

# ---- group: element
fem_design_mesh_size = Panel("0.50")
slab_averagesurfaceelementsize = SlabAverageSurfaceElementSize(Slab=slab_wall, AverageSurfaceElementSize=fem_design_mesh_size)

# ----
merge_3 = Merge(Data1=lineload_force, Data2=pointload_force, Data3=surfaceload_uniform)

# ---- group: assemble
# 5. Assemble the Model
structure_elements = Data(flatten([linesupport_hinged, slab_averagesurfaceelementsize, pointsupport_hinged]))
load_combination = Data(flatten(merge_2))
load_cases = Data(flatten(merge))
loads = Data(flatten(merge_3))
model_createsimple = ModelCreateSimple(
    CountryCode="S",
    StructureElements=structure_elements,
    Loads=loads,
    LoadCases=load_cases,
    LoadCombinations=load_combination)

# ----
# Create a Directory for your Analyses Model
value_list = ValueList({"current directory": 0, "user define folder": 1}, selected="current directory")
current_directory = GhPythonScript()  # -> folder
# ---------- current_directory: Python ----------
import rhinoscriptsyntax as rs

folder = rs.DocumentPath()
# ---------- end current_directory ----------
file_name_end_with_struxml = Panel("analyse_example_model_7.struxml")
directory = FilePath()
stream_filter = StreamFilter(Gate=value_list, Stream0=current_directory, Stream1=directory)
concatenate = Concatenate(FragmentA=stream_filter, FragmentB=file_name_end_with_struxml)
file_path = Data(concatenate)

# ----
# 6. Analysis settings
# Select the analyses you want to run using
# a simple "true" statement. These settings
# are the same as the ones you'd see if you
# ran the analysis in the FEM-Design interface.
analysis_define = AnalysisDefine(
    CalcCase="True",
    CalcCstage=False,
    CalcImpf=False,
    CalcComb="True",
    CalcGmax=False,
    CalcStab=False,
    CalcFreq=False,
    CalcSeis=False,
    CalcDesign=False,
    CalcFootfall=False,
    Elemfine=False,
    Diaphragm=False,
    PeakSmoothing=False)

# ---- group: Calculation
# 6a. Save the model...
# This script is set up to save your model as soon as it finished running.
# However, it needs a file path to work properly. Rightclick the directory
# component and choose "select a directory", then edit the file name
# panel to give your file a name. Remember to end it with .struxml !
fdmodel = Data(model_createsimple)
file_path_2 = Data(file_path)
resulting_file_path = Panel(file_path_2)
model_save = ModelSave(FdModel=fdmodel, FilePathStruxml=file_path_2)

# ----
# 6b. ...or open it in FEM-Design
# If you want, you can call FEM-Design from the script,
# to immediately open your new model.
fdmodel_2 = Data(model_createsimple)
file_path_3 = Data(file_path)
press_to_run_open_model_in_fem_design = Button()
close_all_open_fem_design_windows = BooleanToggle(True)
model_open = ModelOpen(
    FdModel=fdmodel_2,
    FilePathStruxml=file_path_3,
    CloseOpenWindows=close_all_open_fem_design_windows,
    RunNode=press_to_run_open_model_in_fem_design)

# ---- group: calculation
# 6c. Open model and run analysis
# This section will open the model just the same as above, but immediately
# run the analysis with the settings linked in the Analysis settings component.
fdmodel_3 = Data(model_createsimple)
file_path_4 = Data(file_path)
analysis_settings = Data(analysis_define)
press_to_open_model_in_fem_design_and_ru = Button()  # "Press to open model in FEM-Design and run analysis:"
close_all_open_fem_design_windows_when_r = BooleanToggle(True)  # "Close all open FEM-Design windows when running?"
close_fem_design_window_after_analysis_i = BooleanToggle(False)  # "Close FEM-Design window after analysis is done?"
application_runanalysis = ApplicationRunAnalysis(
    FdModel=fdmodel_3,
    FilePathStruxml=file_path_4,
    Analysis=analysis_settings,
    EndSession=close_fem_design_window_after_analysis_i,
    CloseOpenWindows=close_all_open_fem_design_windows_when_r,
    RunNode=press_to_open_model_in_fem_design_and_ru)
