# Grasshopper definition Example 9 - ReadResults.gh (Grasshopper 1.0.7)
# plug-ins: FemDesign.Grasshopper

resultstype = ResultsType({"NodalDisplacement", "PointSupportReaction", "----------------": "", "BarDisplacement", "BarInternalForce", "BarStress", "LineSupportReaction", "----------------": "", "ShellDisplacement", "ShellInternalForce", "ShellStress", "----------------": "", "LabelledSectionInternalForce", "LabelledSectionResultant", "----------------": "", "NodalVibrationShape", "EigenFrequencies", "----------------": "", "QuantityEstimationConcrete", "QuantityEstimationSteel", "QuantityEstimationTimber", "QuantityEstimationTimberPanel", "QuantityEstimationGeneral", "QuantityEstimationReinforcement"}, selected=["NodalDisplacement", "PointSupportReaction"])  # disabled
panel = Panel("myModel.str")  # disabled
# Selecting more than one ResultType will generate a
# DataTree structure in the 'Results' output.
# You can 'BANG' or 'Branch' to select the desire result.
python = GhPythonScript()  # -> out, folder; disabled
# ---------- python: Python ----------
__author__ = "MarcoPellegrinoKonsu"
__version__ = "2022.06.30"

import rhinoscriptsyntax as rs

folder = rs.DocumentPath()
# ---------- end python ----------
concat = Concatenate(FragmentA=python.folder, FragmentB=panel)  # disabled
path = FilePath(concat)  # disabled
readstr = ModelReadStr(StrPath=path, ResultTypes=resultstype)  # -> FdModel, FdFeaModel, Results; disabled
bang = ExplodeTree(Data=readstr.Results)  # -> Branch0, Branch1; disabled
panel_2 = Panel("self weight")  # disabled
panel_3 = Panel("SELF WEIGHT")  # disabled
panel_4 = Panel("1")  # disabled
panel_5 = Panel(bang.Branch1)  # disabled
nodaldisplacement = NodalDisplacement(Result=bang.Branch0, CaseCombinationName=panel_3)  # -> CaseIdentifier, NodeId, Translation, Rotation; disabled
branch = TreeBranch(Tree=readstr.Results, Path=panel_4, MaintainPaths=True)  # disabled
panel_6 = Panel("self weight")  # disabled
pointsupportreaction = PointSupportReaction(Result=branch, CaseCombinationName=panel_6)  # -> CaseIdentifier, Identifier, NodeId, SupportPosition, ReactionForce, ReactionMoment, ForceResultant, MomentResultant; disabled

# ----
# Use 'ResultsType' value list component
# to select the result to be returned.
# NOTE
# The results can be extracted if the model has been analysed.
# FEM-design will generate an ".strFEM" file from which we will read the results.
python_2 = GhPythonScript()  # -> out, folder; same code as python
resultstype_2 = ResultsType({"NodalDisplacement", "PointSupportReaction", "BarDisplacement", "BarInternalForce", "BarStress", "LineSupportReaction", "ShellDisplacement", "ShellInternalForce", "ShellStress", "LabelledSectionInternalForce", "LabelledSectionResultant", "NodalVibrationShape", "EigenFrequencies", "QuantityEstimationConcrete", "QuantityEstimationSteel", "QuantityEstimationTimber", "QuantityEstimationTimberPanel", "QuantityEstimationGeneral", "QuantityEstimationReinforcement"}, selected="NodalDisplacement")
str_file = Panel("myModel.str")
concat_2 = Concatenate(FragmentA=python_2.folder, FragmentB=str_file)
path_2 = FilePath(concat_2)
readstr_2 = ModelReadStr(StrPath=path_2, ResultTypes=resultstype_2)  # -> FdModel, FdFeaModel, Results
nodaldisplacement_2 = NodalDisplacement(Result=readstr_2.Results, CaseCombinationName="SELF WEIGHT")  # -> CaseIdentifier, NodeId, Translation, Rotation

panel_7 = Panel("myModel.str")  # disabled
panel_8 = Panel("""NodalVibrationShape
EigenFrequencies""")  # disabled
# ResultType can also be generated using the CORRECT name.
# We don't recommend this approach.
python_3 = GhPythonScript()  # -> out, folder; disabled; same code as python
concat_3 = Concatenate(FragmentA=python_3.folder, FragmentB=panel_7)  # disabled
path_3 = FilePath(concat_3)  # disabled
readstr_3 = ModelReadStr(StrPath=path_3, ResultTypes=panel_8)  # -> FdModel, FdFeaModel, Results; disabled
bang_2 = ExplodeTree(Data=readstr_3.Results)  # -> Branch0, Branch1; disabled
panel_9 = Panel("1")  # disabled
nodalvibration = NodalVibration(Result=bang_2.Branch0, VibrationMode=panel_9)  # -> ShapeId, Identifier, NodeId, Translation, Rotation; disabled
eigenfrequencies = EigenFrequencies(Result=bang_2.Branch1)  # -> ShapeId, Frequency, Period, ModalMass, MassParticipantXi, MassParticipantYi, MassParticipantZi; disabled

# ---- group: Finite Element from FEMDesign
data = Data(readstr_2.FdFeaModel)
feabar = FdFeaModelFeaBar(FdFeaModel=data)  # -> Identifier, ElementId, NodeI, NodeJ, LineGeometry
feashell = FdFeaModelFeaShell(FdFeaModel=data)  # -> Identifier, ElementId, FaceIndex, MeshGeometry
feanode = FdFeaModelFeaNode(FdfeaModel=data)  # -> NodeId, Point

# ----
pointsupportreaction_2 = PointSupportReaction(Result=bang.Branch1, CaseCombinationName=panel_2)  # -> CaseIdentifier, Identifier, NodeId, SupportPosition, ReactionForce, ReactionMoment, ForceResultant, MomentResultant; disabled
geo = Geometry(feanode.Point)
geo_2 = Geometry(feabar.LineGeometry)
geo_3 = Geometry(feashell.MeshGeometry)
