# Grasshopper definition intSurface_OnBars.gh (Grasshopper 1.0.7)
# plug-ins: FEM-Design

info = Info(versionWhenCreated="23.2.0")
fem_design_connection = FEMDesignConnection(Verbosity="ScriptLogLinesOnly", DeleteOutputFolder=False)
file_struxml = FilePath("C:\GitHub\femdesign-api\FemDesign.Examples\Grasshopper\Interaction_Surface\OnBar\ConcreteBars.struxml")
fem_design_openmodel = FEMDesignOpenModel(Connection=fem_design_connection, Model=file_struxml, RunNode=True)  # -> Connection, Model, Success
model_deconstruct = ModelDeconstruct(Model=fem_design_openmodel.Model)  # -> CountryCode, Foundations, Bars, Shells, LabelledSection, Panels, Loads, LoadCases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
interactionsurface_onbar = InteractionSurfaceOnBar(Bar=model_deconstruct.Bars, FUlt=True, Offset=0)  # -> InteractionSurface, N, My, Mz
panel = Panel(interactionsurface_onbar.My)
panel_2 = Panel(interactionsurface_onbar.N)
panel_3 = Panel(interactionsurface_onbar.Mz)
mesh = Mesh(interactionsurface_onbar.InteractionSurface)
