# Grasshopper definition Practical example - Iterative analysis.gh (Grasshopper 1.0.7)
# plug-ins: FEM-Design

number_slider = Slider(0.591, range=0..1)
crv = Curve([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])
item = ListItem(List=crv, Index=0, Wrap=True)  # -> Item, Item1

# ---- group: LoadSnippet
value_list = ValueList({"ordinary", "dead_load", "soil_dead_load", "shrinkage", "prestressing", "fire", "seis_sxp", "seis_sxm", "seis_syp", "seis_sym"}, selected="ordinary")
value_list_2 = ValueList({"permanent", "long-term", "medium-term", "short-term", "instantaneous"}, selected="permanent")
value_list_3 = ValueList({"ordinary", "dead_load", "soil_dead_load", "shrinkage", "prestressing", "fire", "seis_sxp", "seis_sxm", "seis_syp", "seis_sym"}, selected="dead_load")
value_list_4 = ValueList({"permanent", "long-term", "medium-term", "short-term", "instantaneous"}, selected="permanent")
loadcase_construct = LoadCaseConstruct(Name="LL", Type=value_list, DurationClass=value_list_2)
loadcase_construct_2 = LoadCaseConstruct(Name="DL", Type=value_list_3, DurationClass=value_list_4)
value_list_5 = ValueList({"ultimate_ordinary", "ultimate_accidental", "ultimate_seismic", "serviceability_quasi_permanent", "serviceability_frequent", "serviceability_characteristic"}, selected="ultimate_ordinary")
merge = Merge(Data1=loadcase_construct_2, Data2=loadcase_construct)
panel = Panel("""1.35
1.5""")
Z = UnitZ(Factor="-10.00")
loadcombination_construct = LoadCombinationConstruct(Name="ULS_DL", Type=value_list_5, LoadCase=merge, Gamma=panel)  # -> flatten(LoadCombination)
force = LineLoadForce(Curve=item.Item1, StartForce=Z, LoadCase=loadcase_construct, ConstLoadDir=True, LoadProjection=False)
loadcombinations = Data(loadcombination_construct)
loadcases = Data([loadcase_construct_2, loadcase_construct])

# ----
default = MaterialDatabaseDefault(CountryCode="S")  # -> SteelMaterial, ConcreteMaterial, TimberMaterial, ReinforcementMaterial, StratumMaterial, CustomMaterial
default_2 = SectionDatabaseDefault()  # -> SteelSection, ConcreteSection, TimberSection, HollowCoreSection, CustomSection
panel_2 = Panel("""0.00
1.00""")
join = JoinCurves(Curves=crv, Preserve=False)
item_2 = ListItem(List=default.SteelMaterial, Index=0, Wrap=True)
hframe = HorizontalFrame(Curve=reparameterize(join), Parameter=panel_2)
item_3 = ListItem(List=default_2.SteelSection, Index="10", Wrap=True)
hframe_2 = HorizontalFrame(Curve=reparameterize(join), Parameter=number_slider)
rigid = PointSupportRigid(PointPlane=hframe, Identifier="S")
hinged = PointSupportHinged(PointPlane=hframe_2, Identifier="S")
beam = BarsBeam(Curve=crv, Material=item_2, Section=item_3, OrientLCS=True, Identifier="B")
fem_design_connection = FEMDesignConnection(Verbosity="ScriptLogLinesOnly", DeleteOutputFolder=False)
model_construct = ModelConstruct(
    CountryCode="S",
    StructureElements=[rigid, hinged, beam],
    Loads=force,
    LoadCases=loadcases,
    LoadCombinations=loadcombinations)
resultstype = ResultsType({"NodalDisplacement", "NodalDisplacement", "PointSupportReaction", "PointSupportReactionMinMax", "PointConnectionForce", "BarDisplacement", "BarInternalForce", "BarStress", "LineSupportReaction", "LineConnectionResultant"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}, selected="NodalDisplacement")
resultstype_2 = ResultsType({"NodalDisplacement", "NodalDisplacement", "PointSupportReaction", "PointSupportReactionMinMax", "PointConnectionForce", "BarDisplacement", "BarInternalForce", "BarStress", "LineSupportReaction", "LineConnectionResultant"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}, selected="PointSupportReaction")
merge_2 = Merge(Data1=resultstype, Data2=resultstype_2)
analysis_define = AnalysisDefine(
    CalcCase=True,
    CalcComb=True,
    CalcCstage=False,
    CalcImpf=False,
    CalcGmax=False,
    CalcStab=False,
    CalcFreq=False,
    CalcSeis=False,
    CalcDesign=False,
    CalcFootfall=False,
    Elemfine=True,
    Diaphragm=False,
    PeakSmoothing=False)
# Application.RunCalculation
# If you need to run iterative analysis,
# you need to use `RunCalculation`.
# The component will freeze Grasshopper
# until the solution is not finished.
application_runcalculation = ApplicationRunCalculation(Model=model_construct, Analysis=analysis_define, ResultTypes=merge_2, RunNode=Toggle(True))  # -> Model, FiniteElement, Results
bang = ExplodeTree(Data=application_runcalculation.Results)  # -> Branch0, Branch1
nodaldisplacement = NodalDisplacement(Result=bang.Branch0, CaseCombinationName="ULS_DL")  # -> CaseIdentifier, NodeId, Translation, Rotation
vlen = VectorLength(Vector=nodaldisplacement.Translation)
sort = SortList(Keys=vlen, ValuesA=vlen)  # -> Keys, ValuesA
item_4 = ListItem(List=reverse(sort.Keys), Index=0, Wrap=True)
galapagos = Galapagos(fitness=num, gene=number_slider)
num = Number(item_4)
