# Grasshopper definition Practical example - Post-tensioned cables.gh (Grasshopper 1.0.7)
# plug-ins: FEM-Design

info = Info(versionWhenCreated="23.2.0")
path = FilePath()
path_2 = FilePath()
materialdatabase = MaterialDatabase(CountryCode="S", FilePath=path)  # -> SteelMaterial, ConcreteMaterial, TimberMaterial, ReinforcementMaterial, StratumMaterial, CustomMaterial
sectiondatabase = SectionDatabase(FilePath=path_2)  # -> SteelSection, ConcreteSection, TimberSection, HollowCoreSection, CustomSection

# ----
# Bar
line = Line(Line((0, 0, 0), (10, 0, 0)))
getmaterialbyname_index = MaterialGetMaterialByNameIndex(Materials=materialdatabase.ConcreteMaterial, MaterialNameIndex="C35/45")
getsectionbyname_index = SectionGetSectionByNameIndex(Sections=sectiondatabase.ConcreteSection, SectionNameIndex="Concrete sections, Rectangle, 300x900")
beam = BarsBeam(Curve=line, Material=getmaterialbyname_index, Section=getsectionbyname_index, OrientLCS=True, Identifier="B")

# ----
# Shape of PTC
panel = Panel("-10.0/180.0 * pi")
ptcinner = PtcShapeInner(X="0.4", Z="-0.900", Tangent="0.0", PriorInflectionX="0.1")
ptcinner_2 = PtcShapeInner(X="0.6", Z="-0.900", Tangent="0.0", PriorInflectionX="0.5")
ptcend = PtcShapeEnd(Z="-0.450", Tangent=panel, PriorInflectionX="0.9")
ptcstart = PtcShapeStart(Z="-0.450", Tangent="10.0/180.0 * pi")
merge = Merge(Data1=ptcinner, Data2=ptcinner_2)
shape = PtcShape(Start=ptcstart, Intermidiate=merge, End=ptcend)

# ----
# Post-tensioned cable
panel_2 = Panel("Custom ptc material")
panel_3 = Panel("""0.2
0.4
0.5
0.6
0.8""")
losses = PtcLosses(
    CurvatureCoefficient="0.05",
    WobbleCoefficient="0.007",
    AnchorageSetSlip="0.0",
    ElasticShortening="0.0",
    CreepStress="0.0",
    ShrinkageStress="0.0",
    RelaxationStress="0.0")
strand = PTCStrand(Name=panel_2, FPk="1860.0", AP="150.0", EP="195000.0", Rho="7.810", RelaxationClass="2", Rho1000="0.1")
manufacturing = PtcManufacturing(Positions=panel_3, ShiftX="0.0", ShiftZ="0.1")
list = ValueList({"Start", "End", "Start_then_end", "End_then_start"}, selected="Start")
crv = Curve(line)
define = PTCDefine(
    Line=crv,
    PTCShape=shape,
    PTCLosses=losses,
    PTCManufacturing=manufacturing,
    PTCStrand=strand,
    JackingSide=list,
    JackingStress=Slider(1000, range=1000..1000000),
    NumberOfStrands=Slider(3, range=1..10),
    Identifier="Custom_PTC")

# ----
# Add PTC to bar
deconstruct_modify = BarsDeconstructModify(Bar=beam, PTC=define)  # -> Bar, Guid, Curve, Material, Section, Connectivity, Eccentricity, LocalY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

# ----
# Create model
panel_4 = Panel("S")
model_construct = ModelConstruct(CountryCode=panel_4, StructureElements=deconstruct_modify.Bar)

# ----
# Open model
fem_design_connection = FEMDesignConnection(Verbosity="ScriptLogLinesOnly", DeleteOutputFolder=False)
runnode = BooleanToggle(True)
fem_design_openmodel = FEMDesignOpenModel(Connection=fem_design_connection, Model=model_construct, RunNode=runnode)  # -> Connection, Model, Success
