# Grasshopper definition Example - bridge.gh (Grasshopper 1.0.7)
# plug-ins: FemDesign.Grasshopper

# ---- group: Crossection
width_driving_lane = Slider(5, range=1..50)
width_extra_edge = Slider(6, range=1..50)
height = Slider(4, range=1..50)
width_base = Slider(3, range=1..50)
axis_crossection_base_point = Point(Point(0, 0, 0))

# ---- group: Bridge axis
start_tangent_x = Slider(-8, range=-20..20)
start_tangent_y = Slider(10, range=-20..20)
start_tangent_z = Slider(5, range=-20..20)
bridge_length = Slider(91, range=1..500)
end_tangent_x = Slider(-16, range=-20..20)
end_tangent_y = Slider(10, range=-20..20)
end_tangent_z = Slider(-5, range=-20..20)
axis_crossection_base_point_2 = Point(axis_crossection_base_point)
vector_xyz = VectorXYZ(XComponent=start_tangent_x, YComponent=start_tangent_y, ZComponent=start_tangent_z)  # -> Vector, Length
vector_xyz_2 = VectorXYZ(XComponent=end_tangent_x, YComponent=end_tangent_y, ZComponent=end_tangent_z)  # -> Vector, Length
unit_y = UnitY(Factor=bridge_length)
move = Move(Geometry=axis_crossection_base_point_2, Motion=unit_y)  # -> Geometry, Transform
biarc = BiArc(
    StartPoint=axis_crossection_base_point_2,
    StartTangent=vector_xyz.Vector,
    EndPoint=move.Geometry,
    EndTangent=vector_xyz_2.Vector,
    Ratio=0.5)  # -> FirstArc, SecondArc, BiArc

# ---- group: Raw shape of bridge / WARNING: Higher values means heavier calculation
curve_divisions = Slider(10, range=0..20)

# ---- group: Raw shape of bridge / Type: Normal
loft_options = LoftOptions(Closed=False, Adjust=False, Rebuild=0, Refit=0, Type=0)

# ----
loadcase_create = LoadCaseCreate(Name="Liveload", Type="static", DurationClass="permanent")
loadcase_create_2 = LoadCaseCreate(Name="Deadload", Type="dead_load", DurationClass="permanent")
merge = Merge(Data1=loadcase_create, Data2=loadcase_create_2)

panel = Panel("""1.0
1.0""")
panel_2 = Panel("""1.35
1.5""")
# Laster, lastfall, och lastkombinationer behöver kollas så de faktiskt kan motsvara verkligheten (eller åtminstone ge ett resultat vi kan använda för att bedöma om modellen funkar eller ej). Både kvantitet och hur de är modellerade (liveload etc)
# 
# Just nu brassade jag bara på lite krafter och så får vi se hur det går...
panel_3 = Panel("SLS")
loadcombination_create = LoadCombinationCreate(Name=panel_3, Type="serviceability_characteristic", LoadCase=merge, Gamma=panel)
loadcombination_create_2 = LoadCombinationCreate(Name="ULS", Type="ultimate_ordinary", LoadCase=merge, Gamma=panel_2)
merge_2 = Merge(Data1=loadcombination_create, Data2=loadcombination_create_2)

load_case_liveload = Data(loadcase_create)
load_case_liveload_2 = Data(loadcase_create_2)
bridge_axis = Curve(biarc.BiArc)
point_on_curve = PointOnCurve(bridge_axis, parameter=0)
point_on_curve_2 = PointOnCurve(bridge_axis, parameter=1)
point_on_curve_3 = PointOnCurve(bridge_axis, parameter=0)
point_on_curve_4 = PointOnCurve(bridge_axis, parameter=1)
unit_z = UnitZ(Factor=expr("-x", Slider(1000, range=0..5000)))
unit_z_2 = UnitZ(Factor=expr("-x", Slider(10, range=0..20)))
line = Line(StartPoint=point_on_curve, EndPoint=point_on_curve_2)
line_2 = Line(StartPoint=point_on_curve_3, EndPoint=point_on_curve_4)
lineload_force = LineLoadForce(Curve=line, StartForce=unit_z, LoadCase=load_case_liveload, ConstLoadDir=True)
lineload_force_2 = LineLoadForce(Curve=line_2, StartForce=unit_z_2, LoadCase=load_case_liveload_2, ConstLoadDir=True)
merge_3 = Merge(Data1=lineload_force, Data2=lineload_force_2)

analysis_define = AnalysisDefine(
    CalcCase="true",
    CalcCstage=False,
    CalcImpf=False,
    CalcComb="true",
    CalcGmax=False,
    CalcStab=False,
    CalcFreq=False,
    CalcSeis=False,
    CalcDesign=False,
    CalcFootfall=False,
    Elemfine=False,
    Diaphragm=False,
    PeakSmoothing=False)

# ---- group: Crossection
unit_z_3 = UnitZ(Factor=expr("-x", height))
unit_x = UnitX(Factor=width_driving_lane)
move_2 = Move(Geometry=axis_crossection_base_point, Motion=unit_x)  # -> Geometry, Transform
unit_x_2 = UnitX(Factor=width_extra_edge)
unit_x_3 = UnitX(Factor=width_base)
move_3 = Move(Geometry=axis_crossection_base_point, Motion=unit_z_3)  # -> Geometry, Transform
move_4 = Move(Geometry=move_2.Geometry, Motion=unit_x_2)  # -> Geometry, Transform
move_5 = Move(Geometry=move_3.Geometry, Motion=unit_x_3)  # -> Geometry, Transform
line_3 = Line(StartPoint=move_4.Geometry, EndPoint=move_2.Geometry)
line_4 = Line(StartPoint=move_2.Geometry, EndPoint=axis_crossection_base_point)
line_5 = Line(StartPoint=move_2.Geometry, EndPoint=move_5.Geometry)
line_6 = Line(StartPoint=move_3.Geometry, EndPoint=move_5.Geometry)
merge_4 = Merge(Data1=line_3, Data2=line_4, Data3=line_5, Data4=line_6)
mirror = Mirror(Geometry=merge_4, Plane=PlaneYZ(0, 0, 0))  # -> Geometry, Transform

# ----
flip_curve = FlipCurve(Curve=mirror.Geometry)  # -> Curve, Flag

# ---- group: Crossection (continued)
merge_5 = Merge(Data1=merge_4, Data2=flip_curve.Curve)

# ---- group: Raw shape of bridge
axis_crossection_base_point_3 = Point(axis_crossection_base_point)
crossection = Curve(graft(merge_5))
bridge_axis_2 = Curve(biarc.BiArc)
divide_curve = DivideCurve(Curve=bridge_axis_2, Count=curve_divisions, Kinks=False)  # -> Points, Tangents, Parameters
vector_2pt = Vector2Pt(PointA=axis_crossection_base_point_3, PointB=divide_curve.Points, Unitize=False)  # -> Vector, Length
move_6 = Move(Geometry=crossection, Motion=vector_2pt.Vector)  # -> Geometry, Transform
loft = Loft(Curves=move_6.Geometry, Options=loft_options)

# ---- group: Create mesh
# Inte helt säker på den här, återkom.
# 
# Inställningarna just nu är tagna från Jonis exempel, men han meshade i Rhino istället för i Grasshopper, och fick dessutom trianglar istället för kvadrater - varför?
panel_4 = Panel("20.0")
settings_custom = SettingsCustom(
    StitchSeams=True,
    SimplePlanes=False,
    Refine=True,
    MinCount=16,
    MaxCount=400,
    AspectRatio="2.0",
    MaxDistance=0,
    MaxAngle=panel_4,
    MinEdge="1.5",
    MaxEdge="3.0")
mesh_brep = MeshBrep(Brep=loft, Settings=settings_custom)

# ---- group: Rebuild individual surfaces from mesh
deconstruct_mesh = DeconstructMesh(Mesh=mesh_brep)  # -> Vertices, Faces, Colours, Normals
deconstruct_face = DeconstructFace(Face=deconstruct_mesh.Faces)  # -> CornerA, CornerB, CornerC, CornerD
list_item = ListItem(List=deconstruct_mesh.Vertices, Index=deconstruct_face.CornerC, Wrap=True)
list_item_2 = ListItem(List=deconstruct_mesh.Vertices, Index=deconstruct_face.CornerA, Wrap=True)
list_item_3 = ListItem(List=deconstruct_mesh.Vertices, Index=deconstruct_face.CornerB, Wrap=True)
list_item_4 = ListItem(List=deconstruct_mesh.Vertices, Index=deconstruct_face.CornerD, Wrap=True)
_4point_surface = _4PointSurface(CornerA=list_item_2, CornerB=list_item_3, CornerC=list_item, CornerD=list_item_4)

# ---- group: Supports / Support connection points
# Egentligen borde det vara mer parametriskt än så, så att man kan skriva en lista och så sätter den ut punkter på dessa platser, MEN det här duger så länge.
# 
# Om så, kom ihåg att även stöden måste matcha den datastrukturen (eller sorteras ut till olika fördefinierade typer av stöd)
bridge_axis_3 = Curve(biarc.BiArc)
axis_crossection_base_point_4 = Point(axis_crossection_base_point)
support_connect_right_side = Point(move_5.Geometry)
point_on_curve_5 = PointOnCurve(bridge_axis_3, parameter=1)
point_on_curve_6 = PointOnCurve(bridge_axis_3, parameter=0.5)
mirror_2 = Mirror(Geometry=support_connect_right_side, Plane=PlaneYZ(0, 0, 0))  # -> Geometry, Transform
vector_2pt_2 = Vector2Pt(PointA=axis_crossection_base_point_4, PointB=point_on_curve_5, Unitize=False)  # -> Vector, Length
vector_2pt_3 = Vector2Pt(PointA=axis_crossection_base_point_4, PointB=point_on_curve_6, Unitize=False)  # -> Vector, Length
support_connections_bridge_start = Point([support_connect_right_side, mirror_2.Geometry])
move_7 = Move(Geometry=support_connections_bridge_start, Motion=vector_2pt_3.Vector)  # -> Geometry, Transform
move_8 = Move(Geometry=support_connections_bridge_start, Motion=vector_2pt_2.Vector)  # -> Geometry, Transform

# ---- group: Analysis: are the surfaces planar?
is_planar = IsPlanar(Surface=_4point_surface, Interior=True)  # -> flatten(Planar), Plane
mass_multiplication = MassMultiplication(Input=flatten(is_planar.Planar))  # -> Result, PartialResults
are_the_surfaces_planar = Panel(mass_multiplication.Result)

# ---- group: Constructing element
# Räcker det att ha en mängd losskopplade plates? Ska det vara plate? Återkom hit och kontrollera.
# 
# Och varför säger den att de inte är planar, när [is planar] säger det?
# EDIT: verkar som att analysen accepterar den trots error här - bugg?
panel_5 = Panel("S")
materialdatabase_default = MaterialDatabaseDefault(CountryCode=panel_5)
material_getmaterialbyname = MaterialGetMaterialByName(MaterialDatabase=materialdatabase_default, MaterialName="C25/30")
slab_plate = SlabPlate(Surface=_4point_surface, Thickness=Slider(0.5, range=0.1..1), Material=material_getmaterialbyname, Identifier="P")

# ---- group: Supports / First two supports
rotations_define = RotationsDefine(X_neg="10^7", X_pos="10^7", Y_neg="0", Y_pos="0", Z_neg="0", Z_pos="0")
motions_define = MotionsDefine(X_neg="0", X_pos="0", Y_neg="0", Y_pos="0", Z_neg="10^7", Z_pos="10^7")
pointsupport_define = PointSupportDefine(Point=support_connections_bridge_start, Motions=motions_define, Rotations=rotations_define, Identifier="S")

# ---- group: Supports / Last two supports
rotations_define_2 = RotationsDefine(X_neg="10^7", X_pos="10^7", Y_neg="0", Y_pos="0", Z_neg="0", Z_pos="0")
motions_define_2 = MotionsDefine(X_neg="0", X_pos="0", Y_neg="0", Y_pos="0", Z_neg="10^7", Z_pos="10^7")
pointsupport_define_2 = PointSupportDefine(Point=move_8.Geometry, Motions=motions_define_2, Rotations=rotations_define_2, Identifier="S")

# ---- group: Supports / Middle two supports
rotations_define_3 = RotationsDefine(X_neg="10^7", X_pos="10^7", Y_neg="0", Y_pos="0", Z_neg="0", Z_pos="0")
motions_define_3 = MotionsDefine(X_neg="0", X_pos="0", Y_neg="0", Y_pos="0", Z_neg="10^7", Z_pos="10^7")
pointsupport_define_3 = PointSupportDefine(Point=move_7.Geometry, Motions=motions_define_3, Rotations=rotations_define_3, Identifier="S")

# ----
panel_6 = Panel(is_planar.Planar)

# ---- group: Supports
# Rätta till siffrorna (och stöden, kanske ska vara olika på höger och vänster sida? Behöver kontrolleras
merge_6 = Merge(Data1=pointsupport_define, Data2=pointsupport_define_3, Data3=pointsupport_define_2)

# ----
load_cases = Data(merge)
load_combinations = Data(merge_2)
loads = Data(merge_3)
countrycode_d_dk_est_fin_gb_h_n_pl_ro_s = Panel("S")  # "Countrycode (D/DK/EST/FIN/GB/H/N/PL/RO/S/TR)"
supports = Data(merge_6)
bridge_surfaces = Data(slab_plate)
model_createsimple = ModelCreateSimple(
    CountryCode=countrycode_d_dk_est_fin_gb_h_n_pl_ro_s,
    StructureElements=[supports, bridge_surfaces],
    Loads=loads,
    LoadCases=load_cases,
    LoadCombinations=load_combinations)

file_name_end_with_struxml = Panel("bridge_analysis.struxml")
press_to_open_model_in_fem_design_and_ru = Button()  # "Press to open model in FEM-Design and run analysis:"
close_all_open_fem_design_windows_when_r = BooleanToggle(False)  # "Close all open FEM-Design windows when running?"
close_fem_design_window_after_analysis_i = BooleanToggle(False)  # "Close FEM-Design window after analysis is done?"
directory = FilePath("C:\Users\SamuelNyberg\OneDrive - StruSoft AB\Samuels arbetshörna\3. Practical examples\3.1. Bridge\")
concatenate = Concatenate(FragmentA=directory, FragmentB=file_name_end_with_struxml)
resulting_file_path = Panel(concatenate)
# ERROR: kör ingen analys när båda lasterna är unkopplade. Undersök
analysis_settings = Data(analysis_define)
model = Data(model_createsimple)
application_runanalysis = ApplicationRunAnalysis(
    FdModel=model,
    FilePathStruxml=concatenate,
    Analysis=analysis_settings,
    EndSession=close_fem_design_window_after_analysis_i,
    CloseOpenWindows=close_all_open_fem_design_windows_when_r,
    RunNode=press_to_open_model_in_fem_design_and_ru)
